vi "index.gviweb"   [LabVIEW NXG 5.0.0]
uses:
  NI::WebSockets::Open WebSocket.gvi
  NI::WebSockets::Read Binary.gvi
  NI::WebSockets::Close WebSocket.gvi
diagram:
  while {
    Concatenate Strings("ws://", "localhost", ":6123") -> w1
    sequence {
      frame 0 {
        Property Node(instance in=reference to unnamed text, "Text"=">Trying to Connect<") -> (instance out=w2)
      }
      frame 1 {
        call "Open WebSocket.gvi"(url=w1) -> (websocket session out=w3, error out=w4)
      }
      frame 2 {
        case (w4) {
          frame Error, Default {
            w5 = w2
          }
          frame No Error {
            Property Node(instance in=w2, "Text"=">Connected<") -> (instance out=w5)
          }
        }
      }
    }
    while {
      call "Read Binary.gvi"(websocket session in=w3, error in=w4) -> (websocket session out=w6, binary response=w7, error out=w8)
      Byte Array To String(encoding="UTF-8", unsigned byte array=w7) -> (string=w9)
      s1 = w9  # shift register
      while {
        Match Pattern(regular expression="\n", string=s1) -> (after substring=w11, before substring=w12, match substring=w13, offset past match=w14)
        Reverse String(string=w12) -> (reversed=w15)
        Concatenate Strings(w15, w13) -> w16
        Is Less Than 0(x=w14) -> w17
        append w16 to w10
        next s1 = w11
        stop if w17
      }
      case (w8) {
        frame Error, Default { }
        frame No Error {
          Concatenate Strings(w10) -> w18
          Property Node(instance in=w5, "Text"=w18)
        }
      }
      stop if w8
    }
    call "Close WebSocket.gvi"(websocket session in=w6)
    Wait(time to wait=3000)
    stop if FALSE
  }
